% Simulink data dictionary Struct.sldd

Mixtrue = Simulink.Bus()
  Water: double[2]
  Coffee: double
  Milk: double
  Sugar: double

aCupofCoffee = Simulink.Bus()
  Cup: double
  Water: double[2]
  Coffee: double
  Milk: double
  Sugar: double